# Grasshopper definition BrepTest.ghx (Grasshopper 1.0.7)
# plug-ins: Speckle 2, MeshEdit Components

number_slider = Slider(3, range=0..10)
number_slider_2 = Slider(3, range=0..10)
number_slider_3 = Slider(2, range=0..10)
range = Range(Domain=Domain(0, 1), Steps=number_slider)
range_2 = Range(Domain="-2 to 2", Steps=number_slider_2)
pt = Point(Point(0, 0, 0))
number_slider_4 = Slider(0.4, range=0..1)
pt_2 = ConstructPoint(XCoordinate=graft(range), YCoordinate=range, ZCoordinate=0)
pt_3 = Point(Point(0.7966847394, 0.07208809119, 1.252480454))
pt_4 = Point(Point(0.7966847394, 0.07208809119, 0.135139581))
pt_5 = Point(Point(-0.2375516705, 0.07208809119, -0.2489613433))
pt_6 = ConstructPoint(XCoordinate=graft(range_2), YCoordinate=range_2, ZCoordinate=0)
pt_7 = ConstructPoint(XCoordinate=graft(range_2), YCoordinate=0, ZCoordinate=range_2)
cyl = Cylinder(Base=pt, Radius=0.5, Length=Slider(1, range=0..10))
box = CenterBox(Base=pt_4, X=number_slider_3, Y=number_slider_4, Z=number_slider_4)
srfgrid = SurfaceFromPoints(Points=flatten(pt_2), UCount=expr("x+1", number_slider), Interpolate=False)
box_2 = CenterBox(Base=pt_3, X=number_slider_4, Y=number_slider_4, Z=number_slider_3)
pt_8 = Point(Tree({0;0;0}: [Point(-2, -2, 0), Point(-2, -0.6666666667, 0), Point(-2, 0.6666666667, 0), Point(-2, 2, 0)], {0;0;1}: [Point(-0.6666666667, -2, 0), Point(-0.6666666667, -0.6666666667, -1.468956097), Point(-0.6666666667, 0.6666666667, 1.305453651), Point(-0.6666666667, 2, -0.9238310205)], {0;0;2}: [Point(0.6666666667, -2, 0), Point(0.6666666667, -0.6666666667, 2.759774879), Point(0.6666666667, 0.6666666667, -0.1358726263), Point(0.6666666667, 2, 0)], {0;0;3}: [Point(2, -2, -1.643371203), Point(2, -0.6666666667, 0), Point(2, 0.6666666667, 0), Point(2, 2, 0)]))
pt_9 = Point(Tree({0;0;0}: [Point(-2, 0, -2), Point(-2, 0, -0.6666666667), Point(-2, -1.157601878, 0.6666666667), Point(-2, -1.531644715, 2)], {0;0;1}: [Point(-0.6666666667, 0, -2), Point(-0.6666666667, -0.339197191, -0.6666666667), Point(-0.6666666667, 2.598013607, 0.6666666667), Point(-0.6666666667, 0, 2)], {0;0;2}: [Point(0.6666666667, -1.084035409, -2), Point(0.6666666667, 0.2769907449, -0.6666666667), Point(0.2187878199, -0.6758975856, 0.6666666667), Point(0.6666666667, -0.9859577286, 2)], {0;0;3}: [Point(2, 0, -2), Point(2, 2.242105939, -0.6666666667), Point(2, 0, 0.6666666667), Point(2, 0, 2)]))
cap = CapHoles(Brep=cyl)
box_3 = CenterBox(Base=PlaneXY(0, 0, 0), X=1, Y=1, Z=1)
box_4 = CenterBox(Base=pt_5, X=number_slider_4, Y=number_slider_3, Z=number_slider_4)
Z = UnitZ(Factor=Slider(3, range=0..10))
cir = Circle(Plane=PlaneXY(0, 0, 0), Radius=1)
srfgrid_2 = SurfaceFromPoints(Points=flatten(pt_8), UCount=expr("x+1", number_slider_2), Interpolate=False)
srfgrid_3 = SurfaceFromPoints(Points=flatten(pt_9), UCount=expr("x+1", number_slider_2), Interpolate=invert(True))
brep = Brep(box_3)
trim = TrimSolid(Shape=srfgrid, Cutters=cap)
number_slider_5 = Slider(1, range=0..1)
Z_2 = UnitZ(Factor=Slider(-0.6682, range=-1..1))
python = GhPythonScript(x=cir)  # -> out, a
# ---------- python: Python ----------
import Rhino.Geometry as rg

a = x.ToNurbsCurve()
# ---------- end python ----------
sdiff = SolidDifference(BrepsA=brep, BrepsB=cap)
extr = Extrude(Base=cir, Direction=Z)
sdiff_2 = SolidDifference(BrepsA=brep, BrepsB=[box_2, box, box_4, cap])
move = Move(Geometry=srfgrid_2, Motion=Z_2)  # -> Geometry, Transform
split = SplitBrep(Brep=srfgrid_3)
scale = Scale(Geometry=sdiff, Center=Point(0, 0, 0), Factor=Slider(10, range=0..10))  # -> Geometry, Transform
to_speckle = ToSpeckle(Objects=python.a, KitName="Objects")
sunion = SolidUnion(Breps=[srfgrid_2, srfgrid_3])
python_2 = GhPythonScript(y=cyl)  # -> out, a, b; inputs x: Brep, y: Surface
# ---------- python_2: Python ----------
b = y.ToNurbsSurface()
# ---------- end python_2 ----------
flip = Flip(Surface=[srfgrid_2, srfgrid_3])  # -> Surface, Result
msphereex = MeshSphereEx(Base=PlaneXY(0, 0, 0), Radius=10, Count=5)
to_native = ToNative(Objects=to_speckle, KitName="Objects")
series = Series(Start=0, Step=number_slider_5, Count=Slider(2, range=0..10))
relay = Relay([move.Geometry, srfgrid_3])
sdiff_3 = SolidDifference(BrepsA=sdiff_2, BrepsB=relay)
to_speckle_2 = ToSpeckle(Objects=sdiff_3, KitName="Objects")
to_native_2 = ToNative(Objects=to_speckle_2, KitName="Objects")
srl = Serialize(O=to_speckle_2)
sdiff_4 = SolidDifference(BrepsA=brep, BrepsB=box_4)
pt_10 = Point([Point(6.933961729, -3.869629055, 0), Point(1.136003693, -4.208899822, 0), Point(-1.896360791, 0.3341178344, 0), Point(1.091799117, 4.477686545, 0), Point(5.849853553, 4.470350256, 0), Point(6.017103486, -0.02678989034, 0)])
pt_11 = Point(Point(1, 1, 1))
pt_12 = Point(Point(0, 0, 0))
to_speckle_3 = ToSpeckle(Objects=srfgrid, KitName="Objects")
crv = Curve(to_native)
explode = MeshExplode(Mesh=msphereex, Interpolate=False)
pline = PolyLine(Vertices=pt_10, Closed=invert(False))
brep_2 = Brep(to_native_2)
pt_13 = ConstructPoint(XCoordinate=graft(series), YCoordinate=series, ZCoordinate=0)
box_5 = Box2Pt(PointA=pt_12, PointB=pt_11, Plane=PlaneXY(0, 0, 0))
deserialize = Deserialize(O=srl)
pt_14 = Point([Point(-7.817333337, -6.253343826, 0), Point(-10.02456968, 4.172836202, 1.830920992), Point(10.16226121, 8.408412446, 0), Point(8.777132862, -4.740103994, 0), Point(28.25383308, -7.153124511, 0), Point(27.50993698, 8.01810969, 0)])
panel = Panel(to_speckle_3)
item = ListItem(List=pt_14, Index=0, Wrap=True)  # -> Item, Item1, Item2, Item3, Item4, Item5
brep_3 = Brep([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])
brep_4 = Brep(box_5)
preview = CustomPreview(
    Geometry=brep_2,
    Material={diffuse=RGB(221, 160, 221), emission=RGB(66, 48, 66), shine=0.5, specular=RGB(255, 255, 255), transparency=0})
to_native_3 = ToNative(Objects=deserialize, KitName="Objects")
split_2 = SplitList(List=explode, Index=Slider(100, range=0..100))  # -> ListA, ListB
rectangle = Rectangle(Plane=pt_13, XSize=number_slider_5, YSize=number_slider_5, Radius=0)  # -> Rectangle, Length
brep_5 = Brep(to_native_3)
debrep = DeconstructBrep(Brep=brep_2)  # -> Faces, Edges, Vertices
srf4pt = _4PointSurface(CornerA=item.Item, CornerB=item.Item1, CornerC=item.Item2, CornerD=item.Item3)
split_3 = SplitBrep(Brep=srf4pt, Cutter=pline)
srf4pt_2 = _4PointSurface(CornerA=item.Item3, CornerB=item.Item2, CornerC=item.Item5, CornerD=item.Item4)
demesh = DeconstructMesh(Mesh=explode)  # -> Vertices, Faces, Colours, Normals
pt_15 = Point(Point(-2.493162629, -5.41604814, 0))
srf = Surface(flatten(rectangle.Rectangle))
xz = XZPlane(Origin=Point(0, 0, 0))
edges = BrepEdges(Brep=brep_2)  # -> Naked, Interior, NonManifold
item_2 = ListItem(List=demesh.Vertices, Index=0, Wrap=True)  # -> Item, Item1, Item2, Item3, Item4
edges_2 = BrepEdges(Brep=cyl)  # -> Naked, Interior, NonManifold
box_6 = CenterBox(Base=pt_15, X=1, Y=1, Z=1)
join = BrepJoin(Breps=srf)  # -> Breps, Closed
brep_6 = Brep([srf4pt, srf4pt_2])
item_3 = ListItem(List=debrep.Faces, Index=Slider(4, range=0..10), Wrap=True)
rectangle_2 = Rectangle(Plane=xz, XSize=Domain(-1, 1), YSize=Domain(-2, 2), Radius=0)  # -> Rectangle, Length
srf4pt_3 = _4PointSurface(CornerA=item_2.Item, CornerB=item_2.Item1, CornerC=item_2.Item2, CornerD=item_2.Item3)
join_2 = BrepJoin(Breps=brep_6)  # -> Breps, Closed
split_4 = SplitBrep(Brep=srf4pt, Cutter=box_6)
edges_3 = BrepEdges(Brep=item_3)  # -> Naked, Interior, NonManifold
sdiff_5 = SolidDifference(BrepsA=srf4pt, BrepsB=box_6)
item_4 = ListItem(List=edges.Naked, Index=Slider(0, range=0..4), Wrap=True)
item_5 = ListItem(List=edges_2.Naked, Index=Slider(0, range=0..4), Wrap=True)
split_5 = SplitBrep(Brep=join_2.Breps, Cutter=box_6)
srf_2 = Surface(rectangle_2.Rectangle)
md_slider = MDSlider(
    SliderMode=0,
    slider_value=Point(0.04854523189, 0.9682475765, 0.5),
    x_domain=Domain(0, 1),
    y_domain=Domain(0, 1),
    z_domain=Domain(0, 1))
item_6 = ListItem(List=split_3, Index=0, Wrap=True)
number_slider_6 = Slider(6, range=0..10)
item_7 = ListItem(List=split_4, Index=0, Wrap=True)
cp = ControlPoints(Curve=item_4)  # -> Points, Weights, Knots
cp_2 = ControlPoints(Curve=item_5)  # -> Points, Weights, Knots
curvepoint = PointOnCurve(debrep.Edges, parameter=0.333)
curvepoint_2 = PointOnCurve([debrep.Edges, edges.Interior], parameter=0.333)
join_3 = BrepJoin(Breps=flatten(srf4pt_3))  # -> Breps, Closed
item_8 = ListItem(List=split_5, Index=0, Wrap=True)
number_slider_7 = Slider(1, range=0..1)
multiplication = Multiplication(A=cp.Points, B=cp.Weights)
subtraction = Subtraction(A=cp.Points, B=cp_2.Points)
division = Division(A=subtraction, B=cp.Weights)
evalsrf = EvaluateSurface(Surface=reparameterize(srfgrid_3), Point=md_slider)  # -> Point, Normal, UDirection, VDirection, Frame
vlen = VectorLength(Vector=division)
pt_16 = Point([Point(0.2304264784, 0.1245065727, 0), Point(0.1174252386, 0.5301330901, 0), Point(0.4398833213, 0.8202184117, 0), Point(0.8470526571, 0.4339624696, 0), Point(0.7045404598, 0.1754018585, 0)])
rectangle_3 = Rectangle(Plane=PlaneXY(0, 0, 0), XSize=number_slider_7, YSize=number_slider_7, Radius=0)  # -> Rectangle, Length
srf_3 = Surface(reparameterize(srfgrid_3))
nurbs = NurbsCurve(Vertices=pt_16, Degree=3, Periodic=invert(False))  # -> Curve, Length, Domain
panel_2 = Panel(vlen)
panel_3 = Panel(cp_2.Points)
box_7 = CenterBox(Base=evalsrf.Frame, X=1, Y=1, Z=1)
srf_4 = Surface(reparameterize(rectangle_3.Rectangle))
pline_2 = PolyLine(Vertices=pt_16, Closed=invert(False))
explode_2 = Explode(Curve=pline_2, Recursive=True)  # -> Segments, Vertices
split_6 = SplitBrep(Brep=srfgrid_3, Cutter=box_7)
map_srf = MapToSurface(Curve=nurbs.Curve, Source=srf_4, Target=srf_3)
item_9 = ListItem(List=split_6, Index=0, Wrap=True)
panel_4 = Panel("""0.5
1""")
pull = PullCurve(Curve=map_srf, Surface=srf_3)
number_slider_8 = Slider(6, range=0..10)
c_script = CSharpScript(x=sdiff_4)  # -> out, A; inputs x: Brep
# ---------- c_script: C# ----------
    x.Compact();
    x.MakeValidForV2();
    x.Repair(0.0001);
    A = x;
# ---------- end c_script ----------
shatter = Shatter(Curve=reparameterize(pull), Parameters=panel_4)
cp_3 = ControlPoints(Curve=pull)  # -> Points, Weights, Knots
debrep_2 = DeconstructBrep(Brep=c_script.A)  # -> Faces, Edges, Vertices
addition = Addition(A=number_slider_8, B=Slider(2, range=0..10))
series_2 = Series(Start=Slider(0, range=0..10), Step=1, Count=number_slider_8)
brep_7 = Brep(c_script.A)
srfsplit = SurfaceSplit(Surface=srf_3, Curves=shatter)
item_10 = ListItem(List=debrep_2.Faces, Index=flatten([series_2, addition]), Wrap=True)
to_speckle_4 = ToSpeckle(Objects=sdiff_2, KitName="Objects")
item_11 = ListItem(List=srfsplit, Index=0, Wrap=True)  # -> Item, Item1
debrep_3 = DeconstructBrep(Brep=item_10)  # -> Faces, Edges, Vertices
srl_2 = Serialize(O=to_speckle_4)
panel_5 = Panel(to_speckle_4)
deserialize_2 = Deserialize(O=srl_2)
join_4 = BrepJoin(Breps=item_10)  # -> Breps, Closed
c_script_2 = CSharpScript(x=join_4.Breps)  # -> out, A; inputs x: Brep
# ---------- c_script_2: C# ----------
    x.Repair(0.0001);
    A = x;
# ---------- end c_script_2 ----------
to_native_4 = ToNative(Objects=deserialize_2, KitName="Objects")
curvepoint_3 = PointOnCurve(debrep_3.Edges, parameter=0.415)
brep_8 = Brep(to_native_4)
edges_4 = BrepEdges(Brep=brep_8)  # -> Naked, Interior, NonManifold
preview_2 = CustomPreview(Geometry=brep_8, Material=ColourSwatch(SwatchColor=RGB(181, 228, 255)))
brep_9 = Brep(join_4.Breps)
item_12 = ListItem(List=edges_4.Naked, Index=Slider(5, range=0..5), Wrap=True)
cp_4 = ControlPoints(Curve=edges_4.Interior)  # -> Points, Weights, Knots
debrep_4 = DeconstructBrep(Brep=brep_9)  # -> Faces, Edges, Vertices
pt_17 = Point(Point(0.5, 0.5, 0))
evalsrf_2 = EvaluateSurface(Surface=reparameterize(debrep_3.Faces), Point=pt_17)  # -> flatten(Point), Normal, UDirection, VDirection, Frame
curvepoint_4 = PointOnCurve(debrep_4.Edges, parameter=0.5)
end = EndPoints(Curve=debrep_4.Edges)  # -> Start, End
number_slider_9 = Slider(1, range=0..1)
lng = ListLength(List=curvepoint_4)
subtraction_2 = Subtraction(A=end.End, B=end.Start)
lng_2 = ListLength(List=evalsrf_2.Point)
series_3 = Series(Start=0, Step=1, Count=lng)
series_4 = Series(Start=0, Step=1, Count=lng_2)
tag = TextTag(Location=evalsrf_2.Point, Text=series_4, Colour=ColourSwatch(SwatchColor=RGB(0, 0, 0)))
tag_2 = TextTag(Location=curvepoint_4, Text=series_3, Colour=ColourSwatch(SwatchColor=RGB(0, 80, 199)))
vdis = VectorDisplay(Anchor=end.Start, Vector=subtraction_2)
