# Grasshopper definition RecursiveConversionTests.ghx (Grasshopper 1.0.7)
# plug-ins: Speckle 2

cir = Circle(Plane=PlaneXY(0, 0, 0), Radius=1)
cso = CreateSpeckleObject(A=Slider(2, range=0..10), B=cir)
cso_2 = CreateSpeckleObject(A=cso, B=cir)
cso_3 = CreateSpeckleObject(A=cso_2, B=cir)

to_speckle = ToSpeckle(Data="adfa")
to_native = ToNative(Base=to_speckle)
panel = Panel(to_native)

# ---- group: Convert recursive
to_speckle_2 = ToSpeckle(Data=cso_3)
to_native_2 = ToNative(Base=to_speckle_2)
python = GhPythonScript(x=to_native_2)  # -> out, a, b
# ---------- python: Python ----------
a = x["@A"]
b = x["@B"]
# ---------- end python ----------
python_2 = GhPythonScript(x=python.a)  # -> out, a, b; same code as python
python_3 = GhPythonScript(x=python_2.a)  # -> out, a, b; same code as python

# ---- group: Pass through when expanding
eso = ExpandSpeckleObject(SpeckleObject=cso_3)  # -> A, B
