# Grasshopper definition SurfaceTests.ghx (Grasshopper 1.0.7)
# plug-ins: Speckle 2

number_slider = Slider(4, range=0..10)
accounts = Accounts(
    {"Account (alan@rynne.es | https://staging.speckle.dev)": "ead7b5bb692081ceb2ed3cde2b088187", "Account (alan@rynne.es | http://localhost:3000)": "c17e3b5af2f177869a733cca10850355", "Account (alan@speckle.systems | https://staging.speckle.dev)": "4f3b8d2197550b86f070c641aebd21a8"}, selected="Account (alan@rynne.es | http://localhost:3000)",
    selectedId="c17e3b5af2f177869a733cca10850355",
    selectedServer="http://localhost:3000")
accounts_2 = Accounts(
    {"Account (alan@rynne.es | https://staging.speckle.dev)": "ead7b5bb692081ceb2ed3cde2b088187", "Account (alan@rynne.es | http://localhost:3000)": "c17e3b5af2f177869a733cca10850355", "Account (alan@speckle.systems | https://staging.speckle.dev)": "4f3b8d2197550b86f070c641aebd21a8"}, selected="Account (alan@rynne.es | https://staging.speckle.dev)",
    selectedId="ead7b5bb692081ceb2ed3cde2b088187",
    selectedServer="https://staging.speckle.dev")
series = Series(Start=0, Step=1, Count=number_slider)
construct_point = ConstructPoint(XCoordinate=graft(series), YCoordinate=series, ZCoordinate=0)
surface_from_points = SurfaceFromPoints(Points=flatten(construct_point), UCount=number_slider, Interpolate=False)
create_speckle_object = CreateSpeckleObject(A=surface_from_points)
id_cc631d854e = CreateStream(Account=accounts, stream="cc631d854e http://localhost:3000 c17e3b5af2f177869a733cca10850355")
id_7ed7a7d55e = CreateStream(Account=accounts_2, stream="7ed7a7d55e https://staging.speckle.dev ead7b5bb692081ceb2ed3cde2b088187")

create_speckle_object_2 = CreateSpeckleObject(A=surface_from_points)
serialize = Serialize(O=create_speckle_object_2)
deserialize = Deserialize(O=serialize)
expand_speckle_object = ExpandSpeckleObject(SpeckleObject=create_speckle_object_2)
expand_speckle_object_2 = ExpandSpeckleObject(SpeckleObject=deserialize)
panel = Panel(expand_speckle_object)
panel_2 = Panel(expand_speckle_object_2)
surface = Surface(expand_speckle_object)
surface_2 = Surface(expand_speckle_object_2)

send = Send(
    Data=create_speckle_object,
    Stream=id_cc631d854e,
    Branch="main",
    AutoSend=False,
    BaseId="a60afb8d00609a86a1ea6965db234b36",
    CurrentComponentState="up_to_date",
    KitName="Objects",
    OutputWrappers="http://localhost:3000\tcc631d854e\t7ba76b025d",
    UseDefaultCache=False)  # -> Commits, ObjectId, Data

# ---- group: Conversion Nodes
to_speckle = ToSpeckle(Objects=surface_from_points, KitName="Objects")
serialize_2 = Serialize(O=to_speckle)
deserialize_2 = Deserialize(O=serialize_2)
to_native = ToNative(Objects=to_speckle, KitName="Objects")
to_native_2 = ToNative(Objects=deserialize_2, KitName="Objects")
panel_3 = Panel(to_native)
panel_4 = Panel(to_native_2)
surface_3 = Surface(to_native)
surface_4 = Surface(to_native_2)

# ----
receive = Receive(
    Stream=id_cc631d854e,
    AutoReceive=False,
    CurrentComponentState="up_to_date",
    KitName="Objects",
    LastInfoMessage="Alan Rynne @ 2020-11-06T10:23:22.683Z: Grasshopper push. (id:7ba76b025d)",
    ReceivedObjectId="a60afb8d00609a86a1ea6965db234b36",
    StreamWrapper="http://localhost:3000/streams/cc631d854e?u=c17e3b5af2f177869a733cca10850355")  # -> Data, Info
panel_5 = Panel(send.Commits)
expand_speckle_object_3 = ExpandSpeckleObject(SpeckleObject=receive.Data)
serialize_3 = Serialize(O=send.Data)
surface_5 = Surface(expand_speckle_object_3)
panel_6 = Panel(expand_speckle_object_3)
