# Grasshopper definition ExtendObjectTest.ghx (Grasshopper 1.0.7)
# plug-ins: Speckle 2

list = Accounts(
    {"Account (alan@rynne.es | http://localhost:3000)": "c17e3b5af2f177869a733cca10850355"}, selected="Account (alan@rynne.es | http://localhost:3000)",
    selectedId="c17e3b5af2f177869a733cca10850355",
    selectedServer="http://localhost:3000")
list_2 = Accounts(
    {"Account (alan@rynne.es | http://localhost:3000)": "c17e3b5af2f177869a733cca10850355"}, selected="Account (alan@rynne.es | http://localhost:3000)",
    selectedId="c17e3b5af2f177869a733cca10850355",
    selectedServer="http://localhost:3000")
sph = Sphere(Base=PlaneXY(0, 0, 0), Radius=1)
repeat = RepeatData(Data=sph, Length=Slider(100, range=0..100))
panel = Panel("""ABBC
CCD""")
entwine = Entwine(Branch00=repeat, Branch01="/Original", FlattenInputs=True)
id_9abc86882e = CreateStream(Account=list, stream="9abc86882e http://localhost:3000 c17e3b5af2f177869a733cca10850355")
panel_2 = Panel(id_9abc86882e)
create_object_by_key_value = CreateObjectByKeyValue(Keys=panel, Values=entwine)
cso = CreateSpeckleObject(A="/Original", B="/Original", C="/Original")  # -> Debug, SpeckleObject
cso_2 = CreateSpeckleObject(A="/Original", B="/Original", C="/Original")
sup = StreamUpdate(Stream=id_9abc86882e, Name="asdfas", Description="desc", Public=Toggle(True))
id_5f843f1aaa = CreateStream(Account=list_2, stream="5f843f1aaa http://localhost:3000 c17e3b5af2f177869a733cca10850355")
eso = ExpandSpeckleObject(SpeckleObject=cso_2)  # -> A, B, C
slist = StreamList(Account=list, Limit=10)
receive = Receive(
    ID=id_5f843f1aaa,
    AutoReceive=False,
    CurrentComponentState="expired",
    LastInfoMessage="Alan Rynne @ 2020-10-26T09:56:32.848Z: Grasshopper push. (id:2646c6e8e3)",
    ReceivedObjectId="5eab318e575d1bb9958a11f667c4f34c",
    StreamWrapper="http://localhost:3000/streams/5f843f1aaa?u=c17e3b5af2f177869a733cca10850355")  # -> Data, Info
sget = StreamGet(StreamID=sup, Account=list)
send = Send(
    Data=create_object_by_key_value,
    Stream=id_5f843f1aaa,
    Branch="main",
    AutoSend=True,
    BaseId="0ea0506688ddc6c58c65e65a424e7c2b",
    CurrentComponentState="up_to_date",
    OutputWrappers="http://localhost:3000\t5f843f1aaa\t82c2547948",
    UseDefaultCache=True)  # -> Commits, ObjectId, Data
receive_2 = Receive(
    ID=id_5f843f1aaa,
    AutoReceive=True,
    CurrentComponentState="up_to_date",
    LastInfoMessage="Alan Rynne @ 2020-10-26T09:58:41.551Z: Grasshopper push. (id:82c2547948)",
    ReceivedObjectId="0ea0506688ddc6c58c65e65a424e7c2b",
    StreamWrapper="http://localhost:3000/streams/5f843f1aaa?u=c17e3b5af2f177869a733cca10850355")  # -> Data, Info
panel_3 = Panel(send.Data)
eso_2 = ExpandSpeckleObject(SpeckleObject=send.Data)  # -> ABBC, CCD
eso_3 = ExpandSpeckleObject(SpeckleObject=receive.Data)  # -> ABBC, CCD
eso_4 = ExpandSpeckleObject(SpeckleObject=receive_2.Data)  # -> ABBC, CCD
sdet = StreamDetails(StreamID=sget)  # -> StreamID, Name, Description, CreatedAt, UpdatedAt, Public, Collaborators, Branches
panel_4 = Panel([sdet.Name, sdet.Description, sdet.Public])
sb = SpeckleBase(panel_4)
panel_5 = Panel(sb)
