# Grasshopper definition schema-builder.gh (Grasshopper 1.0.7)
# plug-ins: Speckle 2

# ---- group: Columns
Z = UnitZ(Factor=1)
pt = Point([<point referenced from the Rhino model> x2])
move = Move(Geometry=pt, Motion=Z)  # -> Geometry, Transform
panel = Panel("M_Rectangular Column")
panel_2 = Panel("475 x 610mm")
ln = Line(StartPoint=pt, EndPoint=move.Geometry)

# ---- group: Levels
cso = LevelByName(Name="Level 2", seed="105d884f905a21cf5aaf")
cso_2 = LevelByName(Name="Level 1", seed="238b03bcfaf90d0b6372")

# ---- group: Exterior walls
panel_3 = Panel("Generic - 200mm")
panel_4 = Panel("Basic Wall")
crv = Curve([<curve referenced from the Rhino model> x7])

# ---- group: Windows
number_slider = Slider(6, range=-2..10)
panel_5 = Panel("""0
1
2
3
4
5""")
item = ListItem(List=crv, Index=panel_5, Wrap=True)
panel_6 = Panel("M_Fixed")
curvepoint = PointOnCurve(item, parameter=0.526)
panel_7 = Panel("2000 x 1830mm")
lng = ListLength(List=crv)

# ---- group: Door
item_2 = ListItem(List=crv, Index=Slider(6, range=-2..10), Wrap=True)
panel_8 = Panel("M_Single-Flush")
curvepoint_2 = PointOnCurve(item_2, parameter=0.526)
panel_9 = Panel("0915 x 2134mm")
lng_2 = ListLength(List=crv)

# ---- group: Curtain wall
panel_10 = Panel("Storefront")
panel_11 = Panel("Curtain Wall")
crv_2 = Curve(<curve referenced from the Rhino model>)

# ---- group: Floor
panel_12 = Panel("Generic 150mm")
panel_13 = Panel("Floor")
join = JoinCurves(Curves=crv_2, Preserve=False)
crv_3 = Curve(<curve referenced from the Rhino model>)
offset = OffsetCurve(Curve=crv_3, Distance=Slider(0.1, range=0..0.1), Plane=PlaneXY(0, 0, 0), Corners=1)

# ---- group: Roof
panel_14 = Panel("Generic - 400mm")
panel_15 = Panel("Basic Roof")
crv_4 = Curve(<curve referenced from the Rhino model>)

# ----
cso_3 = RevitFootprintRoof(Outline=crv_4, Family=panel_15, Type=panel_14, Level=cso, seed="1517b8ae1ead623a09a8")
cso_4 = FamilyInstance(BasePoint=curvepoint_2, Family=panel_8, Type=panel_9, Level=cso_2, seed="fa111540bf3c20bd5227")
cso_5 = FamilyInstance(BasePoint=curvepoint, Family=panel_6, Type=panel_7, Level=cso_2, seed="305ad5fe618a4b0e227d")
cso_6 = RevitFloor(Outline=offset, Family=panel_13, Type=panel_12, Level=cso_2, seed="8fe52c11ac0248855b21")
cso_7 = WallByCurveAndLevels(Family=panel_11, Type=panel_10, BaseLine=crv_2, Level=cso_2, TopLevel=cso, seed="db0a365d077c1de3398f")
cso_8 = VerticalColumn(Family=panel, Type=panel_2, BaseLine=ln, Level=cso_2, TopLevel=cso, seed="2036a1723fd0aadbf9b0")
merge = Merge(Data1=cso_5, Data2=cso_4)
cso_9 = WallByCurveAndLevels(
    Family=panel_4,
    Type=panel_3,
    BaseLine=graft(crv),
    Level=cso_2,
    TopLevel=cso,
    Elements=graft(merge),
    seed="b3f74c0ef4b393de73b9")

# ---- group: Add items at indices
c_script = CSharpScript()  # -> out, flatten(A); inputs items: list, indices: list of Int32, length: Int32
# ---------- c_script: C# ----------
    var objects = new List<object>();
    for(var i = 0; i < length; i++){
      if(indices.Contains(i))
        objects.Add(items[i]);
      else
        objects.Add(null);
    }
    A = objects;
# ---------- end c_script ----------

# ----
merge_2 = Merge(Data1=cso_9, Data2=cso_7, Data3=cso_6, Data4=cso_3, Data5=cso_8)  # -> flatten(Result)
send = Send(
    Data=merge_2,
    Stream="https://staging.speckle.dev/streams/b710c1a443",
    Branch="main",
    AutoSend=False,
    BaseId="e415b454feb8aab5095d753489f443c0",
    CurrentComponentState="up_to_date",
    KitName="Objects",
    OutputWrappers="https://staging.speckle.dev\tb710c1a443\t7b149d9b2b",
    UseDefaultCache=True)  # -> Commits, ObjectId, Data
